# Grasshopper definition problem.gh (Grasshopper 1.0.7)

# ----
# Development Tools
# Reload Python Modules (if Module Code is Changed)
python_module_to_reload = Panel("""compas
compas_fab
roslibpy
integral_timber_joints""")
reload = Button()
py = PythonScript(reload_module_button=reload, module_names=python_module_to_reload)  # inputs module_names: list
# ---------- py: Python ----------
import compas_ghpython
from compas_ghpython import unload_modules
if reload_module_button:
    for module in module_names:
        unload_modules(module)
# ---------- end py ----------

# ----
# Check Path and Environment
compas_version = GhPythonScript()  # -> out, compas_version, compas_fab_version, compas_path, compas_fab_path, compas_env_name, python_directory
# ---------- compas_version: Python ----------
__author__ = "leungp"
__version__ = "2020.04.20"

import rhinoscriptsyntax as rs
import compas
import compas_fab
compas_version  = compas.__version__
compas_fab_version = compas_fab.__version__
import os
compas_path = os.path.abspath(compas.__file__)
compas_fab_path = os.path.abspath(compas_fab.__file__)

import compas_bootstrapper
compas_env_name = compas_bootstrapper.ENVIRONMENT_NAME
python_directory = compas_bootstrapper.PYTHON_DIRECTORY
# ---------- end compas_version ----------
compas_environment_name = Panel(compas_version.compas_env_name)
compas_version_2 = Panel(compas_version.compas_version)
compas_fab_version = Panel(compas_version.compas_fab_version)
compas_path = Panel(compas_version.compas_path)
compas_fab_path = Panel(compas_version.compas_fab_path)
python_directory = Panel(compas_version.python_directory)

python_module_to_reload_2 = Panel("npp2")
reload_2 = Button()

# ----
# Specify Collision Models
panel = Panel("""box_back
box_left
box_right
box_front
box_bottom""")
brep = Brep([<brep referenced from the Rhino model> x5])
mesh_brep = MeshBrep(
    Brep=brep,
    Settings={GridMaxCount=0, GridMinCount=16, JaggedSeams=False, MaxEdgeLength=0, MinEdgeLength=0.0001, MinTolerance=0, Refine=True, RefineAngle=0, RelativeTolerance=0.65, SimplePlanes=True, Tolerance=0})
triangulate = Triangulate(Mesh=mesh_brep)  # -> Mesh, Count

py_2 = PythonScript(reload_module_button=reload_2, module_names=python_module_to_reload_2)  # inputs module_names: list; same code as py
load = GhPythonScript(repo_relative_path="tool\BioPrint901\BioPrint901.json")  # -> out, load_path, loaded_object
# ---------- load: Python ----------
from Rhino.RhinoDoc import ActiveDoc
from compas.data import json_load
import os
current_doc_path = os.path.split(ActiveDoc.Path)[0]
root_folder = os.path.dirname(os.path.dirname(current_doc_path))
load_path = root_folder + os.path.sep + repo_relative_path
loaded_object = json_load(load_path)
# ---------- end load ----------

# ----
# Load Robot Model / Semantics / Tools
panel_2 = Panel("robot\gofa10\crb15000_10kg_model.json")
xy_plane = XYPlane(Origin=Point(0, 0, 0))
load_2 = GhPythonScript(repo_relative_path="robot\gofa10\crb15000_10kg_semantics.json")  # -> out, load_path, loaded_object; same code as load
load_3 = GhPythonScript(repo_relative_path=panel_2)  # -> out, load_path, loaded_object; same code as load
tool_attachment_frame = Plane(xy_plane)
single_tool_robotcell = GhPythonScript(
    robot_model=load_3.loaded_object,
    robot_semantics=load_2.loaded_object,
    tool_model=load.loaded_object,
    touch_link="link_6",
    attachment_frame=tool_attachment_frame,
    rigid_body_ids=panel,
    rigid_bodies=triangulate.Mesh)  # -> out, robot_cell, robot_cell_state; inputs touch_link: list, rigid_body_ids: list, rigid_bodies: list of Mesh
# ---------- single_tool_robotcell: Python ----------
from compas_fab.robots import RobotCell
from compas_fab.robots import RigidBody
from compas_rhino.conversions import plane_to_compas_frame
from compas_rhino.conversions import mesh_to_compas
attachment_frame = plane_to_compas_frame(attachment_frame) if attachment_frame else None

tool_models = {tool_model.name: tool_model}
rigid_body_models = {}
if rigid_body_ids or rigid_bodies:
    assert len(rigid_body_ids) == len(rigid_bodies)
    for id, mesh in zip(rigid_body_ids, rigid_bodies):
        rigid_body = RigidBody.from_mesh(mesh_to_compas(mesh))
        rigid_body_models[id] = rigid_body

robot_cell = RobotCell( robot_model, robot_semantics, tool_models, rigid_body_models)

robot_cell_state = robot_cell.default_cell_state()

robot_cell_state.tool_states[tool_model.name].attached_to_group = robot_cell.main_group_name
robot_cell_state.tool_states[tool_model.name].touch_links = touch_link or []
robot_cell_state.tool_states[tool_model.name].attachment_frame = attachment_frame
# ---------- end single_tool_robotcell ----------

curve = Curve([<curve referenced from the Rhino model> x2])

# ----
# Safety Plane
number_slider = Slider(0.46, range=0..1)
construct_point = ConstructPoint(XCoordinate=0, YCoordinate=0, ZCoordinate=number_slider)
xy_plane_2 = XYPlane(Origin=construct_point)

curve_2 = Curve(curve)
end_points = EndPoints(Curve=curve_2)  # -> graft(Start), graft(End)
explode = Explode(Curve=curve_2, Recursive=True)  # -> Segments, Vertices

# ----
# Specify Preview Configuration
number_slider_2 = Slider(0, range=-4..4)
ghpython_script = GhPythonScript(
    robot_cell_state=single_tool_robotcell.robot_cell_state,
    value_0=number_slider_2,
    value_1=Slider(0.15, range=-4..4),
    value_2=Slider(0.3, range=-4..4),
    value_3=Slider(0, range=-4..4),
    value_4=Slider(-0.45, range=-4..4),
    value_5=Slider(0, range=-4..4))  # -> out, configuration, robot_cell_state
# ---------- ghpython_script: Python ----------
from compas.geometry import Frame
__author__ = "leungp"
__version__ = "2024.10.11"
robot_cell_state = robot_cell_state.copy()
configuration = robot_cell_state.robot_configuration
keys = list(configuration.keys())

values = [eval("value_"+str(i)) for i in range (6)]
for key, value in zip(keys, values):
    configuration[key] = value
    print (key, value)
# ---------- end ghpython_script ----------
forward_kinematics = GhPythonScript(robot_cell=single_tool_robotcell.robot_cell, robot_cell_state=ghpython_script.robot_cell_state)  # -> out, pcf, tcf, ocf
# ---------- forward_kinematics: Python ----------
from compas_rhino.conversions import frame_to_rhino

group = group or robot_cell.main_group_name
frame = robot_cell.forward_kinematics_target_frame(robot_cell_state,"ROBOT")
pcf = frame_to_rhino(frame)

if robot_cell_state.get_attached_tool_id(group):
    frame = robot_cell.forward_kinematics_target_frame(robot_cell_state,"TOOL")
    tcf = frame_to_rhino(frame)

if robot_cell_state.get_attached_workpiece_ids(group):
    frame = robot_cell.forward_kinematics_target_frame(robot_cell_state,"WORKPIECE")
    ocf = frame_to_rhino(frame)
# ---------- end forward_kinematics ----------

project = Project(Geometry=end_points.Start, Plane=xy_plane_2)  # -> Geometry, Transform
project_2 = Project(Geometry=end_points.End, Plane=xy_plane_2)  # -> Geometry, Transform
split_list = SplitList(List=explode.Vertices, Index=1)  # -> ListA, ListB
# Retract End
unit_z = UnitZ(Factor="-1")
# Approach Start
unit_z_2 = UnitZ(Factor="-1")
unit_z_3 = UnitZ(Factor="-1")
# First Point
panel_3 = Panel("TOOL")
pointaxiswaypoints = GhPythonScript(points=project_2.Geometry, z_axes=unit_z, mode="TOOL")  # -> out, waypoint; inputs points: list of Point3d, z_axes: list
# ---------- pointaxiswaypoints: Python ----------
from compas_fab.robots import PointAxisWaypoints
from compas_rhino.conversions import point_to_compas
from compas_rhino.conversions import vector_to_compas

target_point = [point_to_compas(p) for p in points]
target_z_axis = [vector_to_compas(z) for z in z_axes]
target_points_and_axes = zip(target_point, target_z_axis)
target_mode = mode
waypoint = PointAxisWaypoints(target_points_and_axes, target_mode)
# ---------- end pointaxiswaypoints ----------
pointaxiswaypoints_2 = GhPythonScript(points=project.Geometry, z_axes=unit_z_2, mode=panel_3)  # -> out, waypoint; inputs points: list of Point3d, z_axes: list; same code as pointaxiswaypoints
pointaxiswaypoints_3 = GhPythonScript(points=split_list.ListA, z_axes=unit_z_3, mode="TOOL")  # -> out, waypoint; inputs points: list of Point3d, z_axes: list; same code as pointaxiswaypoints

extruderon = GhPythonScript()  # -> out, task
# ---------- extruderon: Python ----------
from npp2.tasks import ExtruderOn

task = ExtruderOn()
# ---------- end extruderon ----------
list_length = ListLength(List=project.Geometry)
duplicate_data = DuplicateData(Data=extruderon.task, Number=list_length, Order=True)

extruderoff = GhPythonScript()  # -> out, task
# ---------- extruderoff: Python ----------
from npp2.tasks import ExtruderOff

task = ExtruderOff()
# ---------- end extruderoff ----------
list_length_2 = ListLength(List=project.Geometry)
duplicate_data_2 = DuplicateData(Data=extruderoff.task, Number=list_length_2, Order=True)

extruderoff_2 = GhPythonScript()  # -> out, task; same code as extruderoff
list_length_3 = ListLength(List=project.Geometry)
duplicate_data_3 = DuplicateData(Data=extruderoff_2.task, Number=list_length_3, Order=True)

# ----
# Visualize the Robot Cell
visualization_scale = Slider(1, range=0..2)
visualize_robotcell = GhPythonScript(
    robot_cell=single_tool_robotcell.robot_cell,
    robot_cell_state=ghpython_script.robot_cell_state,
    draw_collision=Toggle(False),
    draw_visual=Toggle(True),
    native_scale=visualization_scale)  # -> out, meshes; inputs draw_collision: Boolean, draw_visual: Boolean
# ---------- visualize_robotcell: Python ----------
from compas_fab.ghpython import cache_scene_object

model = robot_cell
kwargs = {
'draw_collision': draw_collision,
'draw_visual': draw_visual,
'native_scale': native_scale,
}
scene_object = cache_scene_object(model, kwargs, ghenv.Component, debug=True)

# Update Scene Object with new state
scene_object.update(robot_cell_state)
meshes = scene_object.draw()
# ---------- end visualize_robotcell ----------

cartesian_motion = GhPythonScript(waypoint=pointaxiswaypoints_2.waypoint, tag="firstmove", speed_type="40")  # -> out, task
# ---------- cartesian_motion: Python ----------
from npp2.tasks import RoboticLinearMovement

target = waypoint
task = RoboticLinearMovement(target, speed_type=speed_type, tag=tag)
# ---------- end cartesian_motion ----------
cartesian_motion_2 = GhPythonScript(waypoint=pointaxiswaypoints_3.waypoint, tag="approach", speed_type="40")  # -> out, task; same code as cartesian_motion
cartesian_motion_3 = GhPythonScript(waypoint=pointaxiswaypoints.waypoint, tag="retract", speed_type="40")  # -> out, task; same code as cartesian_motion

# ----
# Save the Robot Cell
# Clicking save takes a while
save = Button()
python = GhPythonScript(filename="gofa_10_cell_120box.rc", robot_cell=single_tool_robotcell.robot_cell, output=save)  # -> out, json_location
# ---------- python: Python ----------
from Rhino.RhinoDoc import ActiveDoc
import os
from compas import json_dump
json_location = os.path.split(ActiveDoc.Path)[0]

if robot_cell:
    robot_cell_path = json_location + os.path.sep + filename

if output:
    if robot_cell:
        with open(robot_cell_path, 'w') as f:
            # Use pretty=True because False will cause be a bug for PyBullet
            json_dump(robot_cell, f, minimal=True, pretty=False)
# ---------- end python ----------

# ----
# Print Path
panel_4 = Panel("-1")
unit_z_4 = UnitZ(Factor=panel_4)

pointaxistarget = GhPythonScript(point=split_list.ListB, z_axis=unit_z_4, mode="TOOL")  # -> out, target; inputs point: Point3d
# ---------- pointaxistarget: Python ----------
from compas_fab.robots import PointAxisTarget
from compas_rhino.conversions import point_to_compas
from compas_rhino.conversions import vector_to_compas

target_point = point_to_compas(point)
target_z_axis = vector_to_compas(z_axis) 
target_points_and_axes = zip(target_point, target_z_axis)
target_mode = mode
target = PointAxisTarget(target_point,target_z_axis,target_mode)
# ---------- end pointaxistarget ----------

pointaxiswaypoints_4 = GhPythonScript(targets=pointaxistarget.target)  # -> out, waypoint; inputs targets: list
# ---------- pointaxiswaypoints_4: Python ----------
from compas_fab.robots import PointAxisWaypoints

target_points_and_axes = []
for target in targets:
    target_points_and_axes.append((target.target_point, target.target_z_axis))
waypoint = PointAxisWaypoints(target_points_and_axes, targets[0].target_mode)
# ---------- end pointaxiswaypoints_4 ----------

cartesian_motion_4 = GhPythonScript(waypoint=pointaxiswaypoints_4.waypoint, tag="print", speed_type="40")  # -> out, task; same code as cartesian_motion
merge = Merge(
    Data1=simplify(duplicate_data_3),
    Data2=simplify(cartesian_motion.task),
    Data3=simplify(cartesian_motion_2.task),
    Data4=simplify(duplicate_data),
    Data5=simplify(cartesian_motion_4.task),
    Data6=simplify(duplicate_data_2),
    Data7=simplify(cartesian_motion_3.task))  # -> simplify(Result)
param_viewer = ParamViewer(merge)
list_length_4 = ListLength(List=param_viewer)
series = Series(Start=0, Step=1, Count=list_length_4)
concatenate = Concatenate(Fragment_A="path_", Fragment_B=series, A=".process")  # -> graft(Result)

# ----
# Save the Problem
save_2 = Button()
problem = GhPythonScript(filename=concatenate, start_robot_cell_state=ghpython_script.robot_cell_state, tasks=merge, output=save_2)  # -> out, process_path; inputs tasks: list
# ---------- problem: Python ----------
from Rhino.RhinoDoc import ActiveDoc
import os
from compas import json_dump
json_location = os.path.split(ActiveDoc.Path)[0]

from npp2.tasks import PrintingProcess

if start_robot_cell_state and tasks:
    process_path = json_location + os.path.sep + filename
    print(process_path)
    process = PrintingProcess(start_robot_cell_state, tasks)
    if output:
        with open(process_path, 'w') as f:
            # Use pretty=True because False will cause be a bug for PyBullet
            json_dump(process, f, pretty=False, minimal=True)
# ---------- end problem ----------

# ----
# Test Changing Base Location
# Parallel Gripper - PG500
# Save
# Save
# Load Test
# Load Test
# Test Motion
# Test Motion
# Artist
# Artist
# Test Changing Base Location
# Parallel Gripper - PG1000
# Save
# Load Test
# Artist
# Test Motion
# Save
# Load Test
# Test Motion
# Artist
# Parallel Gripper - PG1500
# Save
# Load Test
# Test Motion
# Artist
panel_5 = Panel(problem.out)
