# Grasshopper definition robot_model_export.gh (Grasshopper 1.0.7)

image_sampler = ImageSampler(FilePath="C:\Users\leungp\Desktop\joint.png", Filter="Colour", Interpolate=False, Umax=1, Umin=0, Vmax=1, Vmin=0, Wrap=1)
image_sampler_2 = ImageSampler(
    FilePath="C:\Users\leungp\Desktop\inertial.png",
    Filter="Colour",
    Interpolate=False,
    Umax=1,
    Umin=0,
    Vmax=1,
    Vmin=0,
    Wrap=1)
unit_y = UnitY(Factor=1)
unit_z = UnitZ(Factor="-1")
mesh = Mesh(<mesh referenced from the Rhino model>)

mesh_2 = Mesh([<mesh referenced from the Rhino model> x3])
point = Point(<point referenced from the Rhino model>)
xy_plane = XYPlane(Origin=point)
link = GhPythonScript(collision_meshes=mesh_2, visual_meshes=mesh, link_name="link_4", origin=xy_plane)  # -> out, link; inputs collision_meshes: list of Mesh, visual_meshes: list of Mesh, origin: Plane
# ---------- link: Python ----------
"""Provides a scripting component.
    Inputs:
        collision_meshes: The collision meshes for the link
        visual_meshes: The visual meshes for the link
        link_name: The y script variable
        origin: The Plane that describes the origin of the link.
    Output:
        link: The new compas robots Link object"""

__author__ = "leungp"
__version__ = "2024.10.10"

import rhinoscriptsyntax as rs
from compas.geometry import Transformation
from compas_robots.model import Link
from compas_robots.model import LinkGeometry
from compas_robots.model import MeshDescriptor

from compas_robots.model import Visual
from compas_robots.model import Collision
from compas_rhino.conversions import mesh_to_compas
from compas_rhino.conversions import plane_to_compas_frame

assert collision_meshes
assert visual_meshes

if origin:
    origin = plane_to_compas_frame(origin)
    transformation = Transformation.from_frame(origin).inverse()
    print("Meshes Transformed by {}".format(transformation))

visuals = []
for m in visual_meshes:
    visual = Visual(LinkGeometry(MeshDescriptor("")))
    cm = mesh_to_compas(m)
    if origin:
        cm.transform(transformation)
    visual.geometry.shape.meshes = [cm]
    visuals.append(visual)

collisions = []
for m in collision_meshes:
    collision = Collision(LinkGeometry(MeshDescriptor("")))
    cm = mesh_to_compas(m)
    if origin:
        cm.transform(transformation)
    collision.geometry.shape.meshes = [cm]
    collisions.append(collision)

link = Link(name=link_name, visual = visuals, collision = collisions)
# ---------- end link ----------

mesh_3 = Mesh(<mesh referenced from the Rhino model>)

mesh_4 = Mesh([<mesh referenced from the Rhino model> x2])
point_2 = Point(<point referenced from the Rhino model>)
link_2 = GhPythonScript(collision_meshes=mesh_4, visual_meshes=mesh_3, link_name="base_link", origin=point_2)  # -> out, link; inputs collision_meshes: list of Mesh, visual_meshes: list of Mesh, origin: Plane; same code as link

mesh_5 = Mesh(<mesh referenced from the Rhino model>)

point_3 = Point(<point referenced from the Rhino model>)
mesh_6 = Mesh([<mesh referenced from the Rhino model> x2])
xy_plane_2 = XYPlane(Origin=point_3)
link_3 = GhPythonScript(collision_meshes=mesh_6, visual_meshes=mesh_5, link_name="link_5", origin=xy_plane_2)  # -> out, link; inputs collision_meshes: list of Mesh, visual_meshes: list of Mesh, origin: Plane; same code as link

mesh_7 = Mesh(<mesh referenced from the Rhino model>)

mesh_8 = Mesh(<mesh referenced from the Rhino model>)
point_4 = Point(<point referenced from the Rhino model>)
xy_plane_3 = XYPlane(Origin=point_4)
link_4 = GhPythonScript(collision_meshes=mesh_8, visual_meshes=mesh_7, link_name="link_6", origin=xy_plane_3)  # -> out, link; inputs collision_meshes: list of Mesh, visual_meshes: list of Mesh, origin: Plane; same code as link

mesh_9 = Mesh(<mesh referenced from the Rhino model>)

mesh_10 = Mesh(<mesh referenced from the Rhino model>)
point_5 = Point(<point referenced from the Rhino model>)
xy_plane_4 = XYPlane(Origin=point_5)
link_5 = GhPythonScript(collision_meshes=mesh_10, visual_meshes=mesh_9, link_name="link_3", origin=xy_plane_4)  # -> out, link; inputs collision_meshes: list of Mesh, visual_meshes: list of Mesh, origin: Plane; same code as link

mesh_11 = Mesh(<mesh referenced from the Rhino model>)

mesh_12 = Mesh(<mesh referenced from the Rhino model>)
point_6 = Point(<point referenced from the Rhino model>)
xy_plane_5 = XYPlane(Origin=point_6)
link_6 = GhPythonScript(collision_meshes=mesh_12, visual_meshes=mesh_11, link_name="link_2", origin=xy_plane_5)  # -> out, link; inputs collision_meshes: list of Mesh, visual_meshes: list of Mesh, origin: Plane; same code as link

mesh_13 = Mesh(<mesh referenced from the Rhino model>)

point_7 = Point(<point referenced from the Rhino model>)
mesh_14 = Mesh(<mesh referenced from the Rhino model>)
xy_plane_6 = XYPlane(Origin=point_7)
link_7 = GhPythonScript(collision_meshes=mesh_14, visual_meshes=mesh_13, link_name="link_1", origin=xy_plane_6)  # -> out, link; inputs collision_meshes: list of Mesh, visual_meshes: list of Mesh, origin: Plane; same code as link

supported_types = ValueList({"REVOLUTE": 0, "CONTINUOUS": 1, "PRISMATIC": 2, "FIXED": 3, "FLOATING": 4, "PLANAR": 5}, selected="REVOLUTE")
curve = Curve(<curve referenced from the Rhino model>)
end_points = EndPoints(Curve=curve)  # -> Start, End
vector_2pt = Vector2Pt(PointA=end_points.Start, PointB=end_points.End, Unitize=False)  # -> Vector, Length
radians = Radians(Degrees=Slider(270, range=0..1000))
radians_2 = Radians(Degrees=Slider(-270, range=-1000..1000))
joint = GhPythonScript(
    name="joint_1",
    type=supported_types,
    origin=end_points.Start,
    axis=vector_2pt.Vector,
    parent_link=link_2.link,
    child_link=link_7.link,
    lower_limit=radians_2,
    upper_limit=radians)  # -> out, joint; inputs type: Int32, origin: Plane, axis: Vector3d
# ---------- joint: Python ----------
__author__ = "leungp"
__version__ = "2024.10.10"

import rhinoscriptsyntax as rs
from compas_robots.model import Joint
from compas_robots.model import Limit
from compas_robots.model import Axis

from compas_rhino.conversions import plane_to_compas_frame
from compas_rhino.conversions import vector_to_compas

axis = vector_to_compas(axis).unitized()
urdf_axis = Axis()
urdf_axis.x = axis.x
urdf_axis.y = axis.y
urdf_axis.z = axis.z

parent = parent_link.name if hasattr(parent_link, 'name') else str(parent_link)
child = child_link.name if hasattr(child_link, 'name') else str(child_link)

joint = Joint(
    name = name,
    type = type,
    parent = parent,
    child = child, 
    origin = plane_to_compas_frame(origin), 
    axis = urdf_axis,
    limit = Limit(lower = lower_limit, upper = upper_limit),
    )
# ---------- end joint ----------

supported_types_2 = ValueList({"REVOLUTE": 0, "CONTINUOUS": 1, "PRISMATIC": 2, "FIXED": 3, "FLOATING": 4, "PLANAR": 5}, selected="REVOLUTE")
curve_2 = Curve(<curve referenced from the Rhino model>)
orient = Orient(Geometry=curve_2, Source=xy_plane_6, Target=PlaneXY(0, 0, 0))  # -> Geometry, Transform
radians_3 = Radians(Degrees=Slider(180, range=0..1000))
radians_4 = Radians(Degrees=Slider(-180, range=-1000..1000))
end_points_2 = EndPoints(Curve=orient.Geometry)  # -> Start, End
vector_2pt_2 = Vector2Pt(PointA=end_points_2.Start, PointB=end_points_2.End, Unitize=False)  # -> Vector, Length
joint_2 = GhPythonScript(
    name="joint_2",
    type=supported_types_2,
    origin=end_points_2.Start,
    axis=vector_2pt_2.Vector,
    parent_link=link_7.link,
    child_link=link_6.link,
    lower_limit=radians_4,
    upper_limit=radians_3)  # -> out, joint; inputs type: Int32, origin: Plane, axis: Vector3d; same code as joint

supported_types_3 = ValueList({"REVOLUTE": 0, "CONTINUOUS": 1, "PRISMATIC": 2, "FIXED": 3, "FLOATING": 4, "PLANAR": 5}, selected="REVOLUTE")
curve_3 = Curve(<curve referenced from the Rhino model>)
orient_2 = Orient(Geometry=curve_3, Source=xy_plane, Target=PlaneXY(0, 0, 0))  # -> Geometry, Transform
radians_5 = Radians(Degrees=Slider(180, range=0..1000))
radians_6 = Radians(Degrees=Slider(-180, range=-1000..1000))
end_points_3 = EndPoints(Curve=orient_2.Geometry)  # -> Start, End
vector_2pt_3 = Vector2Pt(PointA=end_points_3.Start, PointB=end_points_3.End, Unitize=False)  # -> Vector, Length
joint_3 = GhPythonScript(
    name="joint_5",
    type=supported_types_3,
    origin=end_points_3.Start,
    axis=vector_2pt_3.Vector,
    parent_link=link.link,
    child_link=link_3.link,
    lower_limit=radians_6,
    upper_limit=radians_5)  # -> out, joint; inputs type: Int32, origin: Plane, axis: Vector3d; same code as joint

supported_types_4 = ValueList({"REVOLUTE": 0, "CONTINUOUS": 1, "PRISMATIC": 2, "FIXED": 3, "FLOATING": 4, "PLANAR": 5}, selected="REVOLUTE")
curve_4 = Curve(<curve referenced from the Rhino model>)
orient_3 = Orient(Geometry=curve_4, Source=xy_plane_4, Target=PlaneXY(0, 0, 0))  # -> Geometry, Transform
radians_7 = Radians(Degrees=Slider(180, range=0..1000))
radians_8 = Radians(Degrees=Slider(-180, range=-1000..1000))
end_points_4 = EndPoints(Curve=orient_3.Geometry)  # -> Start, End
vector_2pt_4 = Vector2Pt(PointA=end_points_4.Start, PointB=end_points_4.End, Unitize=False)  # -> Vector, Length
joint_4 = GhPythonScript(
    name="joint_4",
    type=supported_types_4,
    origin=end_points_4.Start,
    axis=vector_2pt_4.Vector,
    parent_link=link_5.link,
    child_link=link.link,
    lower_limit=radians_8,
    upper_limit=radians_7)  # -> out, joint; inputs type: Int32, origin: Plane, axis: Vector3d; same code as joint

supported_types_5 = ValueList({"REVOLUTE": 0, "CONTINUOUS": 1, "PRISMATIC": 2, "FIXED": 3, "FLOATING": 4, "PLANAR": 5}, selected="REVOLUTE")
curve_5 = Curve(<curve referenced from the Rhino model>)
orient_4 = Orient(Geometry=curve_5, Source=xy_plane_2, Target=PlaneXY(0, 0, 0))  # -> Geometry, Transform
radians_9 = Radians(Degrees=Slider(270, range=0..1000))
radians_10 = Radians(Degrees=Slider(-270, range=-1000..1000))
end_points_5 = EndPoints(Curve=orient_4.Geometry)  # -> Start, End
vector_2pt_5 = Vector2Pt(PointA=end_points_5.Start, PointB=end_points_5.End, Unitize=False)  # -> Vector, Length
joint_5 = GhPythonScript(
    name="joint_6",
    type=supported_types_5,
    origin=end_points_5.Start,
    axis=vector_2pt_5.Vector,
    parent_link=link_3.link,
    child_link=link_4.link,
    lower_limit=radians_10,
    upper_limit=radians_9)  # -> out, joint; inputs type: Int32, origin: Plane, axis: Vector3d; same code as joint

supported_types_6 = ValueList({"REVOLUTE": 0, "CONTINUOUS": 1, "PRISMATIC": 2, "FIXED": 3, "FLOATING": 4, "PLANAR": 5}, selected="REVOLUTE")
curve_6 = Curve(<curve referenced from the Rhino model>)
orient_5 = Orient(Geometry=curve_6, Source=xy_plane_5, Target=PlaneXY(0, 0, 0))  # -> Geometry, Transform
radians_11 = Radians(Degrees=Slider(85, range=0..1000))
radians_12 = Radians(Degrees=Slider(-225, range=-1000..1000))
end_points_6 = EndPoints(Curve=orient_5.Geometry)  # -> Start, End
vector_2pt_6 = Vector2Pt(PointA=end_points_6.Start, PointB=end_points_6.End, Unitize=False)  # -> Vector, Length
joint_6 = GhPythonScript(
    name="joint_3",
    type=supported_types_6,
    origin=end_points_6.Start,
    axis=vector_2pt_6.Vector,
    parent_link=link_6.link,
    child_link=link_5.link,
    lower_limit=radians_12,
    upper_limit=radians_11)  # -> out, joint; inputs type: Int32, origin: Plane, axis: Vector3d; same code as joint

deconstruct_plane = DeconstructPlane(Plane=PlaneXY(0, 0, 0))  # -> Origin, XAxis, YAxis, ZAxis

# ----
# Preview location (moving away from original location)
number_slider = Slider(2, range=0..10)
unit_y_2 = UnitY(Factor=number_slider)

robotlibrary_ur5 = GhPythonScript()  # -> out, robot, robot_model, semantics; disabled
# ---------- robotlibrary_ur5: Python ----------
from compas_fab.robots import RobotLibrary

robot = RobotLibrary.ur5()
robot_model = robot.model
semantics = robot.semantics
# ---------- end robotlibrary_ur5 ----------
ghpython_script = GhPythonScript(semantics=robotlibrary_ur5.semantics)  # -> out, json; disabled
# ---------- ghpython_script: Python ----------
json = semantics.to_jsonstring(pretty=True)
# ---------- end ghpython_script ----------
panel = Panel(ghpython_script.json)  # disabled

point_8 = Point(<point referenced from the Rhino model>)

construct_plane = ConstructPlane(Origin=point_8, XAxis=unit_z, YAxis=unit_y)

plane = Plane(construct_plane)
link_8 = GhPythonScript(link_name="tool0", origin=plane)  # -> out, link; inputs collision_meshes: list of Mesh, visual_meshes: list of Mesh, origin: Plane
# ---------- link_8: Python ----------
"""Provides a scripting component.
    Inputs:
        collision_meshes: The collision meshes for the link
        visual_meshes: The visual meshes for the link
        link_name: The y script variable
        origin: The Plane that describes the origin of the link.
    Output:
        link: The new compas robots Link object"""

__author__ = "leungp"
__version__ = "2024.10.10"

import rhinoscriptsyntax as rs
from compas.geometry import Transformation
from compas_robots.model import Link
from compas_robots.model import LinkGeometry
from compas_robots.model import MeshDescriptor

from compas_robots.model import Visual
from compas_robots.model import Collision
from compas_rhino.conversions import mesh_to_compas
from compas_rhino.conversions import plane_to_compas_frame

collision_meshes
visual_meshes

if origin:
    origin = plane_to_compas_frame(origin)
    transformation = Transformation.from_frame(origin).inverse()
    print("Meshes Transformed by {}".format(transformation))

visuals = []
for m in visual_meshes:
    visual = Visual(LinkGeometry(MeshDescriptor("")))
    cm = mesh_to_compas(m)
    if origin:
        cm.transform(transformation)
    visual.geometry.shape.meshes = [cm]
    visuals.append(visual)

collisions = []
for m in collision_meshes:
    collision = Collision(LinkGeometry(MeshDescriptor("")))
    cm = mesh_to_compas(m)
    if origin:
        cm.transform(transformation)
    collision.geometry.shape.meshes = [cm]
    collisions.append(collision)

link = Link(name=link_name, visual = visuals, collision = collisions)
# ---------- end link_8 ----------

supported_types_7 = ValueList({"REVOLUTE": 0, "CONTINUOUS": 1, "PRISMATIC": 2, "FIXED": 3, "FLOATING": 4, "PLANAR": 5}, selected="FIXED")
orient_6 = Orient(Geometry=plane, Source=xy_plane_3, Target=PlaneXY(0, 0, 0))  # -> Geometry, Transform
joint_7 = GhPythonScript(name="joint_6_tool0", type=supported_types_7, origin=orient_6.Geometry, parent_link=link_4.link, child_link=link_8.link)  # -> out, joint; inputs type: Int32, origin: Plane, axis: Vector3d
# ---------- joint_7: Python ----------
__author__ = "leungp"
__version__ = "2024.10.10"

import rhinoscriptsyntax as rs
from compas_robots.model import Joint
from compas_robots.model import Limit
from compas_robots.model import Axis

from compas_rhino.conversions import plane_to_compas_frame
from compas_rhino.conversions import vector_to_compas

if axis:
    axis = vector_to_compas(axis).unitized()
    urdf_axis = Axis()
    urdf_axis.x = axis.x
    urdf_axis.y = axis.y
    urdf_axis.z = axis.z
else:
    urdf_axis = None

parent = parent_link.name if hasattr(parent_link, 'name') else str(parent_link)
child = child_link.name if hasattr(child_link, 'name') else str(child_link)

limit = None
if lower_limit and upper_limit:
    limit = Limit(lower = lower_limit, upper = upper_limit)
joint = Joint(
    name = name,
    type = type,
    parent = parent,
    child = child, 
    origin = plane_to_compas_frame(origin), 
    axis = urdf_axis,
    limit = limit,
    )
# ---------- end joint_7 ----------

robotmodel = GhPythonScript(
    name="crb15000_10kg",
    joints=[joint.joint, joint_2.joint, joint_6.joint, joint_4.joint, joint_3.joint, joint_5.joint, joint_7.joint],
    links=[link_2.link, link_7.link, link_6.link, link_5.link, link.link, link_3.link, link_4.link, link_8.link])  # -> out, robot_model; inputs joints: list, links: list
# ---------- robotmodel: Python ----------
__author__ = "leungp"
__version__ = "2024.10.10"

import rhinoscriptsyntax as rs
from compas_robots import RobotModel

# The following check is essential to ensure a properly formed RobotModel object
# Otherwise the subsequent Scene operation can create infinite loops that crashes.

assert len(joints) + 1 == len(links)

links_dict={}
for link in links:
    assert link.name not in links_dict
    links_dict[link.name] = [None, []]

for joint in joints:
    if str(joint.parent) not in links_dict:
        print ("Parent Link '{}' for Joint {} missing".format(joint.parent, joint.name))
        assert False
    if str(joint.child) not in links_dict:
        print ("Child Link '{}' for Joint {} missing".format(joint.child, joint.name))
        assert False
    links_dict[str(joint.parent)][1].append(str(joint.child))
    links_dict[str(joint.child)][0] = str(joint.parent)

no_parent = [l[0] is None for l in links_dict.values()]
assert sum(no_parent) == 1

robot_model = RobotModel(name, joints, links)
# ---------- end robotmodel ----------

# ----
# Create RobotSemantics
panel_2 = Panel("manipulator")
planning_group = GhPythonScript(
    name=panel_2,
    joints=[joint.joint, joint_2.joint, joint_6.joint, joint_4.joint, joint_3.joint, joint_5.joint],
    links=[link_2.link, link_7.link, link_6.link, link_5.link, link.link, link_3.link, link_4.link, link_8.link])  # -> out, group; inputs joints: list, links: list
# ---------- planning_group: Python ----------
group_joints = []
group_links = []

class Group:
    def __init__(self, name, joints, links):
        self.name = name
        self.joints = joints
        self.links = links

for joint in joints:
    group_joints.append(joint.name)
    link = joint.child.link
    link_name = link.name if hasattr(link, 'name') else str(link)
    group_links.append(link_name)

for link in links:
    link_name = link.name if hasattr(link, 'name') else str(link)
    group_links.append(link_name)
    
group = Group(name, list(set(group_joints)), list(set(group_links)))

print (group.joints)
print (group_joints)
print (group.links)
# ---------- end planning_group ----------
semantics = GhPythonScript(robot_model=robotmodel.robot_model, groups=planning_group.group)  # -> out, semantics; inputs disabled_collisions: list
# ---------- semantics: Python ----------
__author__ = "leungp"
__version__ = "2024.11.20"
from compas_fab.robots import RobotSemantics

import rhinoscriptsyntax as rs

joints = robot_model.joints
joint_names = [joint.name for joint in joints]
link_names = [joint.child_link.name for joint in joints]

groups = {}
groups["manipulator"] = {
    "links": link_names,
    "joints": joint_names,
}
print("groups = {}".format(groups))

disabled_collisions = disabled_collisions or []
for joint in robot_model.iter_joints():
    parent_link_name = joint.parent.link
    child_link_name = joint.child.link
    disabled_collisions.append((parent_link_name, child_link_name))
print("disabled_collisions = {}".format(disabled_collisions))

semantics = RobotSemantics(groups, "manipulator", disabled_collisions=disabled_collisions)
# ---------- end semantics ----------

panel_3 = Panel(robotmodel.robot_model)
panel_4 = Panel(semantics.out)

# ----
# Export RobotModel and RobotSemantics
# Beware, this can take a while to save. Save the GH file before exporting.
save = Button()
python = GhPythonScript(robot_model=robotmodel.robot_model, robot_semantics=semantics.semantics, output=save)  # -> out, json_location, robot_model_filename, robot_semantics_filename
# ---------- python: Python ----------
from Rhino.RhinoDoc import ActiveDoc
import os
from compas import json_dump
json_location = os.path.split(ActiveDoc.Path)[0]
if robot_model:
    robot_model_filename = robot_model.name +"_model.json"
    robot_model_path = json_location + os.path.sep + robot_model_filename
if robot_model and robot_semantics:
    robot_semantics_filename = robot_model.name +"_semantics.json"
    robot_semantics_path = json_location + os.path.sep + robot_semantics_filename

if output:
    import json
    if robot_model:
        with open(robot_model_path, 'w') as f:
            # Use pretty=True because False will cause be a bug for PyBullet
            json_dump(robot_model, f, pretty=True)
    if robot_model and robot_semantics:
        with open(robot_semantics_path, 'w') as f:
            # Use pretty=robot_semantics because False will cause be a bug for PyBullet
            json_dump(robot_semantics, f, pretty=True)
# ---------- end python ----------
tool_model_will_be_saved_to_this_path = Panel(python.json_location)

# ----
# Generate list of Configurations for validating Robot Model with real robot
panel_5 = Panel("""-45
45""")
panel_6 = Panel("""-20
20""")
panel_7 = Panel("""-90
25""")
panel_8 = Panel("""-50
40""")
panel_9 = Panel("""-50
50""")
panel_10 = Panel("""-40
0
40""")
robotmodel_2 = Data(robotmodel.robot_model)
radians_13 = Radians(Degrees=panel_6)
radians_14 = Radians(Degrees=panel_5)
radians_15 = Radians(Degrees=panel_7)
radians_16 = Radians(Degrees=panel_8)
radians_17 = Radians(Degrees=panel_9)
radians_18 = Radians(Degrees=panel_10)
cross_reference = CrossReference(
    ListListA=radians_18,
    ListListB=radians_16,
    ListA=radians_15,
    ListB=radians_17,
    ListC=radians_14,
    ListD=radians_13,
    CrossMode=1)  # -> ListListA, ListListB, ListA, ListB, ListC, ListD
ghpython_script_2 = GhPythonScript(
    robot_model=robotmodel_2,
    value_0=cross_reference.ListListA,
    value_1=cross_reference.ListListB,
    value_2=cross_reference.ListA,
    value_3=cross_reference.ListB,
    value_4=cross_reference.ListC,
    value_5=cross_reference.ListD)  # -> out, configuration_out
# ---------- ghpython_script_2: Python ----------
__author__ = "leungp"
__version__ = "2024.10.11"
configuration_out = robot_model.zero_configuration()
keys = list(configuration_out.keys())

values = [eval("value_"+str(i)) for i in range (6)]
for key, value in zip(keys, values):
    configuration_out[key] = value
    print (key, value)
# ---------- end ghpython_script_2 ----------
panel_11 = Panel(cross_reference.ListListA)
ghpython_script_3 = GhPythonScript(configurations=ghpython_script_2.configuration_out, save=Button())  # -> out, a; inputs configurations: list
# ---------- ghpython_script_3: Python ----------
from Rhino.RhinoDoc import ActiveDoc
from compas.data import json_dump
import os
json_path = os.path.split(ActiveDoc.Path)[0] + os.path.sep + "config_test.json"

if save:
    json_dump(configurations, json_path, pretty=True)
# ---------- end ghpython_script_3 ----------

robotmodel_3 = Data(robotmodel.robot_model)

# ----
# hack it as a ToolModel to change location
point_9 = Point(<point referenced from the Rhino model>)
xy_plane_7 = XYPlane(Origin=point_9)
ghpython_script_4 = GhPythonScript(robot_model=robotmodel.robot_model, tcf=xy_plane_7)  # -> out, tool_model; inputs tcf: Plane
# ---------- ghpython_script_4: Python ----------
__author__ = "leungp"
__version__ = "2024.10.11"

import rhinoscriptsyntax as rs
from compas_robots import ToolModel

from compas_rhino.conversions import plane_to_compas_frame

tool_model = ToolModel.from_robot_model(robot_model, plane_to_compas_frame(tcf))
# ---------- end ghpython_script_4 ----------

# ----
# This SceneObject Component Needs Upgrade
scene_object = GhPythonScript(robot_model=robotmodel_3)  # -> out, scene_object
# ---------- scene_object: Python ----------
__author__ = "leungp"
__version__ = "2024.10.11"
from compas.scene import Scene
from compas.scene import SceneObject
try:
    scene_object = SceneObject(item=robot_model)
except:
    pass
    
from compas_ghpython.drawing import draw_mesh

#scene = Scene()
#scene.add(robot_model)
scene_object = SceneObject(item=robot_model)
# ---------- end scene_object ----------

# ----
# FK Robot Preview Configuration Input
number_slider_2 = Slider(0, range=-4..4)
ghpython_script_5 = GhPythonScript(
    robot_model=robotmodel_3,
    value_0=Slider(0, range=-4..4),
    value_1=number_slider_2,
    value_2=Slider(0.735, range=-4..4),
    value_3=Slider(-0.467, range=-4..4),
    value_4=Slider(-0.392, range=-4..4),
    value_5=Slider(1.367, range=-4..4))  # -> out, configuration_out; same code as ghpython_script_2

# ----
# FK Robot Preview
robotmodelsceneobjectupdate = GhPythonScript(scene_object=scene_object.scene_object, configuration=ghpython_script_5.configuration_out)  # -> out, meshes, frames
# ---------- robotmodelsceneobjectupdate: Python ----------
__author__ = "leungp"
__version__ = "2024.10.11"
from compas_rhino.conversions import frame_to_rhino_plane


scene_object.update(configuration)
meshes = scene_object.draw_collision()
#print ()
frames = [frame_to_rhino_plane(f) for f in scene_object.item.frames]
# ---------- end robotmodelsceneobjectupdate ----------
move = Move(Geometry=robotmodelsceneobjectupdate.meshes, Motion=unit_y_2)  # -> Geometry, Transform

# ----
# FK tool0 Frame
panel_12 = Panel("tool0")
fk = GhPythonScript(robot_model=robotmodel_3, fk_link_name=panel_12, configuration=ghpython_script_5.configuration_out)  # -> out, frame_fk
# ---------- fk: Python ----------
from compas_rhino.conversions import frame_to_rhino_plane

# Perform fk with the Robot Model
frame_fk = robot_model.forward_kinematics(configuration, fk_link_name) 

frame_fk = frame_to_rhino_plane(frame_fk)
# ---------- end fk ----------
move_2 = Move(Geometry=fk.frame_fk, Motion=unit_y_2)  # -> Geometry, Transform

# ----
# FK all link Frames as Points
panel_13 = Panel("""link_1
link_2
link_3
link_4
link_5
link_6""")
fk_2 = GhPythonScript(robot_model=robotmodel_3, fk_link_name=panel_13, configuration=ghpython_script_5.configuration_out)  # -> out, frame_fk; same code as fk
point_10 = Point(fk_2.frame_fk)
move_3 = Move(Geometry=point_10, Motion=unit_y_2)  # -> Geometry, Transform

# ----
# Validation of result and compute error
panel_14 = Panel("tool0")
ghpython_script_6 = GhPythonScript(robot_model=robotmodel_2, fk_link_name=panel_14, results_filename="results.json", robot_native_scale=".001")  # -> out, configurations, frame_fk, frame_measured, error_distance, error_orientation
# ---------- ghpython_script_6: Python ----------
from Rhino.RhinoDoc import ActiveDoc
import os
from compas import json_load
from compas_rhino.conversions import frame_to_rhino_plane
from compas.geometry import axis_angle_from_quaternion

json_path = os.path.split(ActiveDoc.Path)[0] + os.path.sep + results_filename

# Load FK Validation Test Result
results = json_load(json_path)
configurations = [c for (c,f) in results]
frame_measured = [f.scaled(robot_native_scale) for (c,f) in results]

# Perform fk with the Robot Model
frame_fk = [robot_model.forward_kinematics(c, fk_link_name) for (c,f) in results]



# Compute Distance Error
error_distance = [a.point.distance_to_point(b.point) for (a,b) in zip(frame_measured, frame_fk)]
# Compute Orientation Error
delta_frame = [a.to_local_coordinates(b) for (a,b) in zip(frame_measured, frame_fk)]
error_orientation = [axis_angle_from_quaternion(f.quaternion)[1] for f in delta_frame]

# Print statistics
from statistics import mean
def print_stat(message, values):
    print(message + "min={}, max={}, mean={}".format(
        min(values),
        max(values),
        mean(values),
        ))

print_stat("Distance Error (meters): ", error_distance)
print_stat("Orientation Error (radian): ", error_orientation)

# Convert frame to Rhino type
frame_fk = [frame_to_rhino_plane(f) for f in frame_fk]
frame_measured = [frame_to_rhino_plane(f) for f in frame_measured]
# ---------- end ghpython_script_6 ----------
panel_15 = Panel(ghpython_script_6.out)

list_item = ListItem(List=ghpython_script_2.configuration_out, Index=Slider(12, range=0..100), Wrap=False)
